# Grasshopper definition BSA_RhinoToRevit_DirectShapeElements 0.2.1.gh (Grasshopper 1.0.7)
# plug-ins: Rhino.Inside for Autodesk Revit

categories = DirectShapeCategories("autodesk.revit.category.family:genericModel-1.0.0", SearchPattern="Generic Model")
pipeline = GeometryPipeline(
    GroupByLayer=False,
    GroupByType=False,
    IncludeHidden=True,
    IncludeLocked=True,
    LayerFilter="04_ENTOURAGE*04_PLANTERS",
    NameFilter="*",
    SublayerFiltering=True,
    TypeFilter=1073741848)  # disabled
categories_2 = DirectShapeCategories("autodesk.revit.category.local:floors-1.0.0", SearchPattern="Floor")  # disabled
# SITE ELEMENTS
# CORE ELEMENTS
pipeline_2 = GeometryPipeline(
    GroupByLayer=False,
    GroupByType=False,
    IncludeHidden=True,
    IncludeLocked=True,
    LayerFilter="03_ARCH*03_COLUMNS",
    NameFilter="*",
    SublayerFiltering=True,
    TypeFilter=1073741848)
categories_3 = DirectShapeCategories("autodesk.revit.category.family:structuralFraming-1.0.0", SearchPattern="STRUCTURAL FRAMING")
pipeline_3 = GeometryPipeline(
    GroupByLayer=False,
    GroupByType=False,
    IncludeHidden=True,
    IncludeLocked=True,
    LayerFilter="03_ARCH*03_CORRUGATION",
    NameFilter="*",
    SublayerFiltering=True,
    TypeFilter=1073741848)

# ---- group: Simple Material Creation
material = ConvertMaterial(Shader=ColourSwatch(SwatchColor=RGB(157, 187, 235)), TrackingMode=2)

swatch = ColourSwatch(SwatchColor=RGB(152, 168, 72))  # disabled
material_2 = ConvertMaterial(Shader=swatch, TrackingMode=2)  # disabled

material_3 = ConvertMaterial(Shader=ColourSwatch(SwatchColor=RGB(181, 181, 181)), TrackingMode=2)

# ----
dam = DataDam(DataA=pipeline_2, BufferDelay=10000000, BufferMode=0)
dam_2 = DataDam(DataA=pipeline_3, BufferDelay=10000000, BufferMode=0)
dam_3 = DataDam(DataA=pipeline, BufferDelay=10000000, BufferMode=0)  # disabled
panel = Panel("Corrugated Facade")  # disabled
panel_2 = Panel("Facade Frame")  # disabled
panel_3 = Panel("Planters")  # disabled
# SHELL ELEMENTS
geodshape = AddGeometryDirectShape(Name=panel_2, Category=categories_3, Geometry=dam, Material=material_3, TrackingMode=2)  # disabled
geodshape_2 = AddGeometryDirectShape(Name=panel, Category=categories, Geometry=dam_2, Material=material, TrackingMode=2)  # disabled
# will need some fixing
# Add curvature - will need to rebuild spline into curve
geodshape_3 = AddGeometryDirectShape(Name=panel_3, Category=categories_2, Geometry=dam_3, Material=material_2, TrackingMode=2)  # disabled
